# Dynamo custom node Element.Delete.dyf (Dynamo 2.0.1.5055)
# category: JetPack.Revit.Elements
# Delete selected elements

element = Input(element: var[]..[])
flatten = List.Flatten(list=element)
code_block = CodeBlock { false; }
clean = List.Clean(list=flatten, preserveIndices=code_block)
uniqueItems = List.UniqueItems(list=clean)
python_script = Python(IN[0]=uniqueItems)
# ---------- python_script.python (55 lines) ----------
# Copyright(c) 2018, Oleg (Brutich) Zholobov
# @JetPack, http://www.Oleg-Zholobov.com

import clr

# Import DocumentManager and TransactionManager
clr.AddReference("RevitServices")
import RevitServices
from RevitServices.Persistence import DocumentManager
from RevitServices.Transactions import TransactionManager

# Import RevitAPI
clr.AddReference("RevitAPI")
import Autodesk
from Autodesk.Revit.DB import *

doc = DocumentManager.Instance.CurrentDBDocument
uiapp = DocumentManager.Instance.CurrentUIApplication
app = uiapp.Application

from System.Collections.Generic import *

#The inputs to this node will be stored as a list in the IN variable.
dataEnteringNode = IN
elems = UnwrapElement(IN[0])

elemIds = []
nErrors = 0

for elem in elems:
	try:
		elemIds.append(elem.Id)
	except AttributeError:
		nErrors += 1
		pass

#Transaction Start
TransactionManager.Instance.EnsureInTransaction(doc)

nDeleted = 0
nDeletedDependencies = 0
for item in elemIds:
	try:
		deletedIdSet = doc.Delete(item)
		nDeleted += 1
		nDeletedDependencies += len(deletedIdSet) - 1
	except:
		nErrors += 1
		pass
		
#Transaction End
TransactionManager.Instance.TransactionTaskDone()
	
#Assign your output to the OUT variable
OUT = "Successfully deleted elements: {0}.\nDependent elements have also been removed: {1}.\nErrors: {2}".format(nDeleted, nDeletedDependencies, nErrors)
# ----------------------------------------
Report = Output(python_script)
